# Grasshopper definition make path.gh (Grasshopper 1.0.7)

crv = Curve([<curve referenced from the Rhino model> x2])
vec = VectorXYZ(XComponent=Slider(0, range=0..100), YComponent=0, ZComponent=0)  # -> Vector, Length
move = Move(Geometry=crv, Motion=vec.Vector)  # -> Geometry, Transform
line = Line(Line((-41.13307366, -5.620074442, 0), (30.80857681, -5.620074442, 0)))
line_2 = Line(Line((-45.716229, -5.897841432, 0), (-45.78567075, 29.17024109, 0)))
python = GhPythonScript(bottom=line, left=line_2, l=Slider(33, range=20..40), dis=Slider(6, range=1..30), sp=Slider(1, range=1..30))  # -> out, pattern; inputs bottom: Line, left: Line
# ---------- python: Python ----------
import Rhino.Geometry as rg

l = float(l)
dis = float(dis)
sp = float(sp)

# Set the length of the segment
L = bottom.Length
x = (L/(l+dis))
xint = int(x+0.5)
d = L/xint-l

L_2 = left.Length
x_2 = (L_2/sp)
xint_2 = int(x_2+0.5)
s = L_2/xint_2


#----------Generate pattern A----------#
joins = []
a = bottom.From
joins.append(a)

p = rg.Point3d(a.X + (l/2), a.Y, a.Z)
joins.append(p)

for i in range(1, xint):
    c = rg.Point3d(p.X + d, p.Y, p.Z)
    joins.append(c)

    p = rg.Point3d(c.X + l, c.Y, c.Z)
    joins.append(p)

lj = len(joins)-1

p = rg.Point3d(joins[lj].X + d, joins[lj].Y, joins[lj].Z)
joins.append(p)

c = rg.Point3d(p.X + (l/2), p.Y, p.Z)
joins.append(c)

pattern_A = []

for i in range(0, len(joins)-1, 2):
    pattern_A.append(rg.Line(joins[i], joins[i+1]))


#----------Generate pattern B----------#
joins_2 = []
joins_2.append(a)

p_2 = rg.Point3d(a.X + (d/2), a.Y, a.Z)
joins_2.append(p_2)

for i in range(1, xint+1):
    c_2 = rg.Point3d(p_2.X + l, p_2.Y, p_2.Z)
    joins_2.append(c_2)

    p_2 = rg.Point3d(c_2.X + d, c_2.Y, c_2.Z)
    joins_2.append(p_2)

pattern_B = []

for i in range(1, len(joins_2)-1, 2):
    pattern_B.append(rg.Line(joins_2[i], joins_2[i+1]))


# Move pattern B
p_B = []

for line in pattern_B:
    p1 = rg.Point3d(line.FromX, line.FromY + s, line.FromZ)
    p2 = rg.Point3d(line.ToX, line.ToY + s, line.ToZ)
    p_B.append(rg.Line(p1, p2))


# Copy rows
all_patterns = []
all_patterns.extend(pattern_A)
all_patterns.extend(p_B)

current_A = pattern_A[:]
current_B = p_B[:]

for i in range(0, xint_2-1, 2):

    new_A = []
    for line in current_A:
        p1 = rg.Point3d(line.FromX, line.FromY + s*2, line.FromZ)
        p2 = rg.Point3d(line.ToX, line.ToY + s*2, line.ToZ)
        new_A.append(rg.Line(p1, p2))

    new_B = []
    for line in current_B:
        p1 = rg.Point3d(line.FromX, line.FromY + s*2, line.FromZ)
        p2 = rg.Point3d(line.ToX, line.ToY + s*2, line.ToZ)
        new_B.append(rg.Line(p1, p2))

    all_patterns.extend(new_A)
    all_patterns.extend(new_B)

    current_A = new_A
    current_B = new_B


pattern = all_patterns
# ---------- end python ----------
python_2 = GhPythonScript(x=Slider(9, range=0..30), y=Slider(7, range=0..30))  # -> out, a
# ---------- python_2: Python ----------
"""Provides a scripting component.
    Inputs:
        x: The x script variable
        y: The y script variable
        z: another
    Output:
        a: The a output variable"""

__author__ = "Vive"
__version__ = "2026.05.10"

import rhinoscriptsyntax as rs

print("Helo world")
print(x+y)
# ---------- end python_2 ----------
panel = Panel(python_2.out)
panel_2 = Panel(python.out)
panel_3 = Panel(python.pattern)
material_thickness = Slider(3, range=1..10)
left_side = BooleanToggle(True)
tab_width = Slider(13, range=5..50)
make_tabs = BooleanToggle(True)

# ---- group: Generate Tabs
explode = Explode(Curve=move.Geometry, Recursive=True)  # -> Segments, Vertices

# ----
simplify = SimplifyTree(Tree=explode.Segments, Front=False)

# ---- group: Generate Tabs (continued)
panel_4 = Panel(simplify)
python_3 = GhPythonScript(curves=simplify)  # -> out, Lines, Curves; inputs curves: list of Curve
# ---------- python_3: Python ----------
import Rhino.Geometry as rg

straight = []
curved = []

for seg in curves:
    if seg.IsLinear():
        straight.append(seg)
    else:
        curved.append(seg)

Lines = straight
Curves = curved
# ---------- end python_3 ----------
panel_5 = Panel(python_3.Curves)
panel_6 = Panel(python_3.Lines)

# ---- group: Walls and Tabs
section = Slider(0, range=0..10)
height = Slider(32, range=10..200)
branch = TreeBranch(Tree=python_3.Lines, Path=section, MaintainPaths=True)
item = ListItem(List=branch, Index=Slider(4, range=0..10), Wrap=True)
python_4 = GhPythonScript(curve=item, height=height, tabs=make_tabs, depth=material_thickness, width=tab_width, side=left_side)  # -> out, horizontal, vertical, placedHoles; inputs curve: Curve, tabs: Boolean, side: Boolean
# ---------- python_4: Python ----------
import Rhino.Geometry as rg

horizontal = []
vertical = []
baseHoles = []

# measure length of line, and make across X
length = curve.GetLength()

tabcount = int(round((length - width) / width / 2))
# make tabs
# would be a list on tab 0 at 0, width, tab 1 at (1 * 2 width) + (1 * 2 width) + width 
totalWidth = (tabcount * width) + ((tabcount - 1) * width)
offset = (length - totalWidth) / 2

if tabs and tabcount > 0:
    # horizontal lines
    #horizontal.append(rg.Line(rg.Point3d(0,0,0), rg.Point3d(length, 0,0)))
    horizontal.append(rg.Line(rg.Point3d(0,height,0), rg.Point3d(length, height,0)))
    
    #horizontal.append(rg.Line(rg.Point3d(0,10,0), rg.Point3d(totalWidth, 10,0)))
    
    
    # for for start
    # for for end
    
    #for for middle
    tab_positions = []
    
    for i in range(0, tabcount):
        xPos1 = i * 2 * width + offset
        xPos2 = xPos1 + width
        tab_positions.append((xPos1, xPos2))
    
    
    # top baseline before first tab
    horizontal.append(
        rg.Line(
            rg.Point3d(0,0,0),
            rg.Point3d(tab_positions[0][0],0,0)
        )
    )
    
    # create tab pattern on bottom of wall
    for i, (xPos1, xPos2) in enumerate(tab_positions):
    
        # tab bottom
        horizontal.append(
            rg.Line(
                rg.Point3d(xPos1,-depth,0),
                rg.Point3d(xPos2,-depth,0)
            )
        )
        
        # hole bottom
        baseHoles.append(
            rg.Line(
                rg.Point3d(xPos1,-depth,0),
                rg.Point3d(xPos2,-depth,0)
            )
        )
    
        # left vertical
        vertical.append(
            rg.Line(
                rg.Point3d(xPos1,0,0),
                rg.Point3d(xPos1,-depth,0)
            )
        )
        
        # hole vertical
        baseHoles.append(
            rg.Line(
                rg.Point3d(xPos1,0,0),
                rg.Point3d(xPos1,-depth,0)
            )
        )
    
        # right vertical
        vertical.append(
            rg.Line(
                rg.Point3d(xPos2,-depth,0),
                rg.Point3d(xPos2,0,0)
            )
        )
        
        # hole vertical
        baseHoles.append(
            rg.Line(
                rg.Point3d(xPos2,-depth,0),
                rg.Point3d(xPos2,0,0)
            )
        )
    
        # hole top
        baseHoles.append(
            rg.Line(
                rg.Point3d(xPos1,0,0),
                rg.Point3d(xPos2,0,0)
            )
        )
    
        # top segment to next tab
        if i < len(tab_positions)-1:
            nextStart = tab_positions[i+1][0]
    
            horizontal.append(
                rg.Line(
                    rg.Point3d(xPos2,0,0),
                    rg.Point3d(nextStart,0,0)
                )
            )
    
    
    # top baseline after last tab
    horizontal.append(
        rg.Line(
            rg.Point3d(tab_positions[-1][1],0,0),
            rg.Point3d(length,0,0)
        )
    )
    
    # transform base holes
    
    # -------------------------
    # TRANSFORM TO SOURCE LINE
    # -------------------------
    
    
    if side:
        start = curve.PointAtStart
        end = curve.PointAtEnd
    else:
        start = curve.PointAtEnd
        end = curve.PointAtStart
    
    xAxis = end - start
    xAxis.Unitize()
    
    yAxis = rg.Vector3d(-xAxis.Y, xAxis.X, 0)
    
    sourcePlane = rg.Plane.WorldXY
    targetPlane = rg.Plane(start, xAxis, yAxis)
    
    xform = rg.Transform.PlaneToPlane(sourcePlane, targetPlane)
    
    placedHoles = []
    for hole in baseHoles:
        #copy = hole.Duplicate()
        #copy.Transform(xform)
        hole.Transform(xform)
        #placedHoles.append(copy)
        placedHoles.append(hole)
    
    #vertical
    vertical.append(rg.Line(rg.Point3d(0,0,0), rg.Point3d(0, height,0)))
    vertical.append(rg.Line(rg.Point3d(length,0,0), rg.Point3d(length, height,0)))

else:
    # horizontal lines
    horizontal.append(rg.Line(rg.Point3d(0,0,0), rg.Point3d(length, 0,0)))
    horizontal.append(rg.Line(rg.Point3d(0,height,0), rg.Point3d(length, height,0)))
    
    #vertical
    vertical.append(rg.Line(rg.Point3d(0,0,0), rg.Point3d(0, height,0)))
    vertical.append(rg.Line(rg.Point3d(length,0,0), rg.Point3d(length, height,0)))

# close paths??
placedHoles = [ln.ToNurbsCurve() for ln in placedHoles]
placedHoles = rg.Curve.JoinCurves(placedHoles)
# ---------- end python_4 ----------
panel_7 = Panel(python_4.horizontal)

# ----
panel_8 = Panel(python_4.out)
